# Grasshopper definition EUI_shadedepth.gh (Grasshopper 1.0.7)

building_width = Slider(35, range=5..50)
building_depth = Slider(25, range=5..50)
floor_height = Slider(4, range=3..6)
rectangle = Rectangle(Plane=PlaneXY(0, 0, 0), XSize=building_width, YSize=building_depth, Radius=0)  # -> Rectangle, Length
Z = UnitZ(Factor=floor_height)
extr = Extrude(Base=rectangle.Rectangle, Direction=Z)
cap = CapHoles(Brep=extr)
top_z = Slider(56, range=0..100)
typical_z = Slider(28, range=0..100)
Z_2 = UnitZ(Factor=top_z)
Z_3 = UnitZ(Factor=typical_z)
typical_floor = Move(Geometry=cap, Motion=Z_3)  # -> Geometry, Transform
top_floor = Move(Geometry=cap, Motion=Z_2)  # -> Geometry, Transform

# ---- group: 软件环境
config = HBConfig()  # -> python_exe, py_lib_install, rad_install, os_install, ep_install, hb_os_gem, standards, asset_report, default_sim; plug-in component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
panel = Panel(config.os_install)
panel_2 = Panel(config.ep_install)

# ----
roomsolid = HBRoomFromSolid(geo=flatten(typical_floor.Geometry), name="Typical_Floor", conditioned=True)  # -> report, rooms; plug-in component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
roomsolid_2 = HBRoomFromSolid(geo=flatten(top_floor.Geometry), name="Top_Floor", conditioned=True)  # -> report, rooms; plug-in component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
roomsolid_3 = HBRoomFromSolid(geo=flatten(cap), name="Bottom_Floor", conditioned=True)  # -> report, rooms; plug-in component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
exposed_floors = BooleanToggle(True)
middle_floor_multiplier = Slider(13, range=0..30)
adiabaticbytype = HBAdiabaticByType(hb_objs=flatten(roomsolid_2.rooms), exposed_floors=exposed_floors)  # -> hb_objs; plug-in component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
aperturesbyratio = HBAperturesByRatio(hb_objs=flatten(roomsolid_3.rooms), ratio=Slider(0.4, range=0..1))  # -> report, hb_objs; plug-in component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
multiplier = HBSetMultiplier(rooms=roomsolid.rooms, multiplier=middle_floor_multiplier)  # -> report, rooms; plug-in component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
typical_roof_adiabatic = BooleanToggle(True)
typical_floor_adiabatic = BooleanToggle(True)
adiabaticbytype_2 = HBAdiabaticByType(hb_objs=flatten(multiplier.rooms), roofs=typical_roof_adiabatic, exposed_floors=typical_floor_adiabatic)  # -> hb_objs; plug-in component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
wwr = Slider(0.4, range=0..1)
merge = Merge(Data1=aperturesbyratio.hb_objs, Data2=adiabaticbytype_2, Data3=adiabaticbytype)
aperturesbyratio_2 = HBAperturesByRatio(hb_objs=flatten(merge), ratio=wwr)  # -> report, hb_objs; plug-in component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
panel_3 = Panel(merge)
shgc = Slider(0.4, range=0..1)
windowmat = HBWindowMaterial(name="Parametric_Glazing", u_factor=Slider(2, range=0..10), shgc=shgc)  # -> mat; plug-in component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
windowconstr = HBWindowConstruction(name="Parametric_Window", materials=windowmat)  # -> constr; plug-in component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
shade_count = Slider(1, range=0..1)
shadedepth = Slider(1.5, range=0..1.5)
applywindowconstr = HBApplyWindowConstruction(hb_objs=flatten(aperturesbyratio_2.hb_objs), constr=windowconstr)  # -> hb_objs; plug-in component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
searchprog = HBSearchPrograms(keywords="office")  # -> room_prog; plug-in component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
all_air = HBAllAirHVACTemplates({"VAV chiller with gas boiler reheat": "VAV_Chiller_Boiler", "VAV chiller with central air source heat pump reheat": "VAV_Chiller_ASHP", "VAV chiller with district hot water reheat": "VAV_Chiller_DHW", "VAV chiller with PFP boxes": "VAV_Chiller_PFP", "VAV chiller with gas coil reheat": "VAV_Chiller_GasCoil", "VAV air-cooled chiller with gas boiler reheat": "VAV_ACChiller_Boiler", "VAV air-cooled chiller with central air source heat pump reheat": "VAV_ACChiller_ASHP", "VAV air-cooled chiller with district hot water reheat": "VAV_ACChiller_DHW", "VAV air-cooled chiller with PFP boxes": "VAV_ACChiller_PFP", "VAV air-cooled chiller with gas coil reheat": "VAV_ACChiller_GasCoil"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}, selected="VAV chiller with PFP boxes")
item = ListItem(List=searchprog, Index=377, Wrap=True)
louvershades = HBLouverShades(hb_objs=flatten(applywindowconstr), depth=shadedepth, shade_count=shade_count)  # -> report, hb_objs; plug-in component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
bldgvintages = HBBuildingVintages({"ASHRAE 90.1 2019  |  IECC 2021": "2019", "ASHRAE 90.1 2016  |  IECC 2018": "2016", "ASHRAE 90.1 2013  |  IECC 2015": "2013", "ASHRAE 90.1 2010  |  IECC 2012": "2010", "ASHRAE 90.1 2007  |  IECC 2009": "2007", "ASHRAE 90.1 2004  |  IECC 2006": "2004", "1980-2004 (CBECS)": "1980_2004", "Pre-1980 (CBECS)": "pre_1980"}, selected="ASHRAE 90.1 2019  |  IECC 2021")
vizall = HBVisualizeAll(hb_objs=flatten(louvershades.hb_objs))  # -> geo; plug-in component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
applyprogram = HBApplyProgramType(rooms=flatten(louvershades.hb_objs), program=item)  # -> report, rooms; plug-in component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
allairhvac = HBAllAirHVAC(rooms=flatten(applyprogram.rooms), system_type=all_air, vintage=bldgvintages)  # -> report, rooms; plug-in component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
panel_4 = Panel("https://climate.onebuilding.org/WMO_Region_5_Southwest_Pacific/SGP_Singapore/SGP_SG_Singapore-Changi.Intl.AP.486980_TMYx.2011-2025.zip")
downloadepw = LBDownloadWeather(weather_URL=panel_4)  # -> epw_file, stat_file, ddy_file; plug-in component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
model = HBModel(rooms=flatten(allairhvac.rooms), name="EUI_SD15_Test")  # -> report, model; plug-in component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
importepw = LBImportEPW(epw_file=downloadepw.epw_file)  # -> location, dry_bulb_temperature, dew_point_temperature, relative_humidity, wind_speed, wind_direction, direct_normal_rad, diffuse_horizontal_rad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; plug-in component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
model_to_osm = BooleanToggle(True)
simpar = HBSimulationParameter(timestep=6)  # -> sim_par; plug-in component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
write_osm = BooleanToggle(True)
modeltoosm = HBModelToOSM(
    model=model.model,
    epw_file=downloadepw.epw_file,
    sim_par=simpar,
    folder="E:\004-Learning\06-5231 AI\1-GroupProject\EUI_Project",
    write=write_osm,
    run=model_to_osm)  # -> report, jsons, osw, osm, idf, sql, zsz, rdd, html; plug-in component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
translate = BooleanToggle(True)
run = BooleanToggle(True)
runosm = HBRunOSM(osm=modeltoosm.osm, epw_file=downloadepw.epw_file, translate=translate, run=run)  # -> report, idf, sql, zsz, rdd, html; plug-in component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
model_report = Panel(modeltoosm.report)
eui = HBEndUseIntensity(sql=runosm.sql)  # -> eui, eui_end_use, end_uses, gross_floor; plug-in component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
energyplus_report = Panel(runosm.sql)
eui_2 = Panel(eui.eui)
eui组成 = Panel(eui.eui_end_use)
建筑总楼面面积 = Panel(eui.gross_floor)
